# Grasshopper definition boxes.gh (Grasshopper 0.9.76)
# plug-ins: Biomorpher

# In this example, genepools are used to create boxes which are then subtracted
# from the overall bounding box. Double click on the Biomorpher component.
genes = GenePool(
    Decimals=2,
    Maximum=10,
    Minimum=0,
    Value=[3.057407417, 1.327924594, 5.132879915, 6.745123685, 8.580635306, 4.484161755, 6.576147544, 1.246968345, 3.606754632, 8.190461983])
genes_2 = GenePool(
    Decimals=2,
    Maximum=10,
    Minimum=0,
    Value=[7.547058904, 3.49550299, 0.9457296929, 7.446862155, 2.971891879, 0.02582314425, 7.908089099, 8.760188235, 9.508109814, 0.657369532])
genes_3 = GenePool(
    Decimals=2,
    Maximum=10,
    Minimum=0,
    Value=[0.1275685384, 7.317738308, 3.067542693, 1.43277438, 5.967582858, 8.212693188, 1.242438174, 3.468184165, 1.657211241, 6.128899002])
genes_4 = GenePool(
    Decimals=2,
    Maximum=10,
    Minimum=0,
    Value=[3.534693384, 0.4749844319, 5.395430711, 0.7251737736, 3.896046804, 2.812989365, 3.930641703, 6.743312891, 6.141775142, 9.606786994])
genes_5 = GenePool(
    Decimals=2,
    Maximum=10,
    Minimum=0,
    Value=[9.088949966, 9.06391683, 2.408663562, 6.832463893, 4.483664592, 9.843234145, 2.914431404, 1.464716481, 3.940514896, 1.247451595])
genes_6 = GenePool(
    Decimals=2,
    Maximum=10,
    Minimum=0,
    Value=[6.298919179, 0.04910477905, 8.720639799, 9.842108092, 4.792932959, 5.739669109, 8.260381901, 3.700105536, 0.7775408266, 0.3679421173])
dom = ConstructDomain(DomainStart=genes_5, DomainEnd=genes_6)
dom_2 = ConstructDomain(DomainStart=genes_3, DomainEnd=genes_4)
dom_3 = ConstructDomain(DomainStart=genes, DomainEnd=genes_2)
box = DomainBox(Base=PlaneXY(0, 0, 0), X=dom_3, Y=dom_2, Z=dom)
bbox = BoundingBox(Content=box, Plane=PlaneXY(0, 0, 0), UnionBox=True)  # -> Box, Box_2
volume = Volume(Geometry=bbox.Box)  # -> Volume, Centroid
scale = Scale(Geometry=bbox.Box, Center=volume.Centroid, Factor="0.9")  # -> Geometry, Transform
number_slider = Slider(209, range=0..254)
number_slider_2 = Slider(13, range=0..254)
number_slider_3 = Slider(125, range=0..254)
rgb = ColourRGB(Alpha=255, Red=number_slider, Green=number_slider_2, Blue=number_slider_3)
sdiff = SolidDifference(BrepsA=scale.Geometry, BrepsB=box)
mcol = MeshColours(Mesh=sdiff, Colours=rgb)
preview = CustomPreview(Geometry=sdiff, Shader=rgb)
biomorpher = Biomorpher(
    Genome=[number_slider, number_slider_2, number_slider_3, genes, genes_2, genes_3, genes_4, genes_5, genes_6],
    Geometry=mcol)  # -> GenoGuids, Population, Historic, Clusters

# ---- group: Visualise Cluster Distribution
viewer = ParamViewer(biomorpher.Clusters)

# ---- group: Internalise these to store data
id = Guid(biomorpher.GenoGuids)
num = Number(biomorpher.Population)
num_2 = Number(biomorpher.Historic)

# ---- group: Biomorpher Reader component
biomorpherreader = BiomorpherReader(DesignID=Slider(38, range=0..99))
