# Grasshopper definition embryo.gh (Grasshopper 0.9.76)
# plug-ins: Biomorpher, Fröbel, embryoA

block1 = Block1(InTrans=0)  # -> OutBox, OutPlane1, OutPlane2
block2 = Block2(InTrans=1, InHeight=1)  # -> OutBox, OutPlane1, OutPlane2, OutPlane3, OutPoint1
block2_2 = Block2(InTrans=1, InHeight=1)  # -> OutBox, OutPlane1, OutPlane2, OutPlane3, OutPoint1
block2_3 = Block2(InTrans=1, InHeight=1)  # -> OutBox, OutPlane1, OutPlane2, OutPlane3, OutPoint1
link2 = Link2()
# In this example, we combine Biomorpher
# with the plug-in Embryo, to evolve
# parametric models themselves.
number_slider = Slider(37.5, range=0..1000)
g_slider9 = Slider(3.84, range=3..4.5)
g_slider8 = Slider(4.5, range=3..4.5)
g_slider7 = Slider(4.4, range=3..4.5)
g_slider6 = Slider(4.28, range=3..4.5)
g_slider5 = Slider(3.38, range=3..4.5)
g_slider4 = Slider(3.8, range=3..4.5)
g_slider3 = Slider(4.41, range=3..4.5)
g_slider2 = Slider(3.28, range=3..4.5)
g_slider1 = Slider(4.25, range=3..4.5)
g_slider0 = Slider(3.23, range=3..4.5)
number_slider_2 = Slider(4.1, range=0..100)
number_slider_3 = Slider(20, range=0..100)
genes = GenePool(
    Decimals=2,
    Maximum=5,
    Minimum=3,
    Value=[3.228416563, 4.245159467, 3.277310769, 4.409058634, 3.80244141, 3.377038825, 4.278331664, 4.40435266, 4.636401079, 3.838511019])
genes_2 = GenePool(
    Decimals=0,
    Maximum=20,
    Minimum=0,
    Value=[1.360194994, 14.36572163, 16.75429965, 16.70384173, 5.80012639, 10.27005709, 2.052627863, 18.58841371, 14.56932048, 3.250080201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])
genes_3 = GenePool(
    Decimals=0,
    Maximum=4,
    Minimum=0,
    Value=[0.5155929281, 1.257329276, 2.756647535, 3.254311764, 1.636867555, 3.05478126, 1.127670736, 2.03203168, 3.501385891, 3.380583805, 1.606221516, 1.237013688, 1.973300054, 3.331504275, 3.958128132, 3.431698811])
pt = ConstructPoint(XCoordinate=number_slider, YCoordinate=50, ZCoordinate=0)
embryo = EmbryoSettings(
    Preview=Toggle(False),
    SliderDomain=Domain(3, 4.5),
    OneToOne=Toggle(True),
    GridX=120,
    GridY=150,
    RemoveDead=Toggle(True),
    OnlyTerminals=False)
xz = XZPlane(Origin=Point(0, 0, 0))
xz_2 = XZPlane(Origin=pt)
parent_output = ParentOutput(O=[xz, xz_2])
parent_output_2 = ParentOutput(O=number_slider_2)
embryo_2 = Embryo(
    Reset=Toggle(True),
    Sliders=Slider(10, range=0..10),
    Components=Slider(16, range=0..100),
    MetricGenes=genes,
    TopologyGenes=genes_2,
    FunctionGenes=genes_3,
    Settings=embryo,
    RandomOveride=0)  # -> Iterations, Components
g_block2 = Block2(InPlane=xz, InLength=1, AddStoreys=1)  # -> OutBox, OutPlane1, OutPlane2, OutPlane3, OutPoint1
g_block2_2 = Block2(InPlane=xz_2, InLength=g_slider2, AddStoreys=g_slider7)  # -> OutBox, OutPlane1, OutPlane2, OutPlane3, OutPoint1
g_link2 = Link2(InPoint1=g_block2_2.OutPlane1, InPoint2=g_block2.OutPlane1)
g_block2_3 = Block2(InPlane=g_block2.OutPlane3, InLength=1, AddStoreys=1)  # -> OutBox, OutPlane1, OutPlane2, OutPlane3, OutPoint1
g_block2_4 = Block2(InPlane=g_block2_2.OutPlane2, InLength=g_slider8, AddStoreys=number_slider_2)  # -> OutBox, OutPlane1, OutPlane2, OutPlane3, OutPoint1
g_block2_5 = Block2(InPlane=g_block2_2.OutPlane3, InLength=g_slider5, AddStoreys=g_slider4)  # -> OutBox, OutPlane1, OutPlane2, OutPlane3, OutPoint1
g_block2_6 = Block2(InPlane=g_block2_2.OutPoint1, InLength=g_slider0, AddStoreys=g_slider3)  # -> OutBox, OutPlane1, OutPlane2, OutPlane3, OutPoint1
g_link2_2 = Link2(InPoint1=g_block2_5.OutPlane3, InPoint2=xz)
g_block2_7 = Block2(InPlane=g_block2_3.OutPlane1, InLength=1, AddStoreys=1)  # -> OutBox, OutPlane1, OutPlane2, OutPlane3, OutPoint1
g_block2_8 = Block2(InPlane=g_block2_5.OutPoint1, InLength=1, AddStoreys=1)  # -> OutBox, OutPlane1, OutPlane2, OutPlane3, OutPoint1
g_block2_9 = Block2(InPlane=g_block2_3.OutPlane2, InLength=1, AddStoreys=1)  # -> OutBox, OutPlane1, OutPlane2, OutPlane3, OutPoint1
g_block2_10 = Block2(InPlane=g_block2_6.OutPlane2, InLength=g_slider9, AddStoreys=g_slider6)  # -> OutBox, OutPlane1, OutPlane2, OutPlane3, OutPoint1
g_block2_11 = Block2(InPlane=g_block2_9.OutPlane3, InLength=1, AddStoreys=1)  # -> OutBox, OutPlane1, OutPlane2, OutPlane3, OutPoint1
g_block2_12 = Block2(InPlane=g_block2_10.OutPlane1, InLength=g_slider1, AddStoreys=1)  # -> OutBox, OutPlane1, OutPlane2, OutPlane3, OutPoint1
g_link2_3 = Link2(InPoint1=g_block2_4.OutPlane1, InPoint2=g_block2_12.OutPlane2)
g_link2_4 = Link2(InPoint1=g_block2_12.OutPlane1, InPoint2=g_block2_12.OutPoint1)
get_geometry = GetGeometry(G=[g_block2_2.OutBox, g_block2_6.OutBox, g_block2_5.OutBox, g_block2_10.OutBox, g_link2_2, g_block2_4.OutBox, g_block2_12.OutBox, g_link2_4, g_block2.OutBox, g_block2_3.OutBox, g_link2_3, g_block2_9.OutBox, g_link2, g_block2_8.OutBox, g_block2_7.OutBox, g_block2_11.OutBox])
pi = Pi(Factor=Slider(0, range=0..1))
rotate = Rotate(Geometry=get_geometry, Angle=pi, Plane=PlaneXY(0, 0, 0))  # -> Geometry, Transform
geo = Geometry(rotate.Geometry)
number_slider_4 = Slider(102, range=0..254)
number_slider_5 = Slider(91, range=0..254)
smesh = SimpleMesh(Brep=geo)
rgb = ColourRGB(Alpha=255, Red=number_slider_4, Green=0, Blue=number_slider_5)
mcol = MeshColours(Mesh=smesh, Colours=rgb)
biomorpher = Biomorpher(Sliders=[genes, genes_2, genes_3, number_slider_4, number_slider_5], Geometry=mcol)
