# Grasshopper definition embryo02.gh (Grasshopper 0.9.76)
# plug-ins: Biomorpher, Fröbel, embryoA

block1 = Block1(InTrans=0)  # -> OutBox, OutPlane1, OutPlane2
block2 = Block2(InTrans=1, InHeight=1)  # -> OutBox, OutPlane1, OutPlane2, OutPlane3, OutPoint1
block2_2 = Block2(InTrans=1, InHeight=1)  # -> OutBox, OutPlane1, OutPlane2, OutPlane3, OutPoint1
block2_3 = Block2(InTrans=1, InHeight=1)  # -> OutBox, OutPlane1, OutPlane2, OutPlane3, OutPoint1
link2 = Link2()
number_slider = Slider(4.1, range=0..100)
number_slider_2 = Slider(20, range=0..100)
genes = GenePool(
    Decimals=2,
    Maximum=5,
    Minimum=3,
    Value=[3.222396895, 4.425706519, 4.484568921, 4.207893973, 4.86347901, 4.033803834, 4.14711618, 3.096841377, 3.895659191, 3.422875598])
genes_2 = GenePool(
    Decimals=0,
    Maximum=20,
    Minimum=0,
    Value=[17.82842581, 8.688887669, 18.2304122, 16.28186304, 18.51499337, 18.67091165, 5.968558055, 2.412582292, 0.5575580246, 16.25963777])
genes_3 = GenePool(
    Decimals=0,
    Maximum=4,
    Minimum=0,
    Value=[1.010058878, 0.04786090741, 3.818927821, 2.295978333, 3.515145216, 2.058923353, 1.170749859, 3.361996935, 3.009084124, 2.694334387])
g_slider9 = Slider(3.42, range=3..4.5)
g_slider8 = Slider(3.9, range=3..4.5)
g_slider7 = Slider(3.1, range=3..4.5)
g_slider6 = Slider(4.15, range=3..4.5)
g_slider5 = Slider(4.03, range=3..4.5)
g_slider4 = Slider(4.5, range=3..4.5)
g_slider3 = Slider(4.21, range=3..4.5)
g_slider2 = Slider(4.48, range=3..4.5)
g_slider1 = Slider(4.43, range=3..4.5)
g_slider0 = Slider(3.22, range=3..4.5)
pt = ConstructPoint(XCoordinate=Slider(37.5, range=0..1000), YCoordinate=50, ZCoordinate=0)
embryo = EmbryoSettings(
    Preview=Toggle(False),
    SliderDomain=Domain(3, 4.5),
    OneToOne=Toggle(True),
    GridX=120,
    GridY=150,
    RemoveDead=Toggle(True),
    OnlyTerminals=False)
xz = XZPlane(Origin=Point(0, 0, 0))
xz_2 = XZPlane(Origin=pt)
parent_output = ParentOutput(O=[xz, xz_2])
parent_output_2 = ParentOutput(O=number_slider)
embryo_2 = Embryo(
    Reset=Toggle(True),
    Sliders=Slider(10, range=0..10),
    Components=Slider(16, range=0..100),
    MetricGenes=genes,
    TopologyGenes=genes_2,
    FunctionGenes=genes_3,
    Settings=embryo,
    RandomOveride=0)  # -> Iterations, Components
g_block2 = Block2(InPlane=xz_2, InLength=g_slider4, AddStoreys=g_slider6)  # -> OutBox, OutPlane1, OutPlane2, OutPlane3, OutPoint1
g_block2_2 = Block2(InPlane=xz, InLength=number_slider, AddStoreys=g_slider5)  # -> OutBox, OutPlane1, OutPlane2, OutPlane3, OutPoint1
g_block2_3 = Block2(InPlane=xz, InLength=g_slider8, AddStoreys=g_slider7)  # -> OutBox, OutPlane1, OutPlane2, OutPlane3, OutPoint1
g_block2_4 = Block2(InPlane=g_block2_3.OutPlane1, InLength=1, AddStoreys=1)  # -> OutBox, OutPlane1, OutPlane2, OutPlane3, OutPoint1
g_block2_5 = Block2(InPlane=g_block2_3.OutPlane2, InLength=1, AddStoreys=1)  # -> OutBox, OutPlane1, OutPlane2, OutPlane3, OutPoint1
g_block2_6 = Block2(InPlane=g_block2_2.OutPlane2, InLength=g_slider3, AddStoreys=g_slider2)  # -> OutBox, OutPlane1, OutPlane2, OutPlane3, OutPoint1
g_block1 = Block1(InPlane=g_block2_3.OutPlane3, InLength=g_slider0)  # -> OutBox, OutPlane1, OutPlane2
g_link2 = Link2(InPoint1=g_block2_2.OutPlane3, InPoint2=g_block2_6.OutPlane3)
g_link2_2 = Link2(InPoint1=g_block2_2.OutPlane1, InPoint2=g_block1.OutPlane2)
g_block2_7 = Block2(InPlane=g_block2_6.OutPlane2, InLength=1, AddStoreys=1)  # -> OutBox, OutPlane1, OutPlane2, OutPlane3, OutPoint1
g_block2_8 = Block2(InPlane=g_block2_6.OutPoint1, InLength=g_slider9, AddStoreys=g_slider1)  # -> OutBox, OutPlane1, OutPlane2, OutPlane3, OutPoint1
g_link2_3 = Link2(InPoint1=g_block2_7.OutPoint1, InPoint2=g_block2_5.OutPoint1)
g_block2_9 = Block2(InPlane=g_block2_8.OutPlane2, InLength=1, AddStoreys=1)  # -> OutBox, OutPlane1, OutPlane2, OutPlane3, OutPoint1
g_block1_2 = Block1(InPlane=g_block2_7.OutPlane3, InLength=1)  # -> OutBox, OutPlane1, OutPlane2
g_block2_10 = Block2(InPlane=g_block2_7.OutPlane1, InLength=1, AddStoreys=1)  # -> OutBox, OutPlane1, OutPlane2, OutPlane3, OutPoint1
g_link2_4 = Link2(InPoint1=g_block2_10.OutPlane3, InPoint2=g_block2.OutPlane2)
get_geometry = GetGeometry(G=[g_block2_3.OutBox, g_block1.OutBox, g_block2_2.OutBox, g_link2_2, g_block2_6.OutBox, g_link2, g_block2_8.OutBox, g_block2.OutBox, g_block2_5.OutBox, g_block2_7.OutBox, g_block2_10.OutBox, g_block1_2.OutBox, g_block2_4.OutBox, g_link2_3, g_block2_9.OutBox, g_link2_4])
pi = Pi(Factor=Slider(0, range=0..1))
rotate = Rotate(Geometry=get_geometry, Angle=pi, Plane=PlaneXY(0, 0, 0))  # -> Geometry, Transform
geo = Geometry(rotate.Geometry)
smesh = SimpleMesh(Brep=geo)
biomorpher = Biomorpher(Sliders=[genes, genes_2, genes_3], Geometry=smesh)
custom_mesh_settings = SettingsCustom(
    StitchSeams=True,
    SimplePlanes=False,
    Refine=True,
    MinCount=16,
    MaxCount=400,
    AspectRatio=20,
    MaxDistance=0,
    MaxAngle=20,
    MinEdge=0,
    MaxEdge=Slider(3, range=0..100))  # disabled
mesh = MeshBrep(Brep=geo, Settings=custom_mesh_settings)  # disabled
deletef = DeleteFaces()  # disabled
mjoin = MeshJoin(Meshes=mesh)  # disabled
swatch = ColourSwatch(SwatchColor=RGBA(0, 0, 0, 145))  # disabled
# Make some columns
cluster = Cluster(M=mjoin)  # disabled
preview = CustomPreview(Geometry=cluster, Shader=swatch)  # disabled

# ==== cluster Cluster
M = ClusterInput()
facen = FaceNormals(Mesh=M)  # -> Centers, Normals
Z = UnitZ(Factor=1)
dprod = DotProduct(VectorA=facen.Normals, VectorB=Z, Unitize=True)
smaller = SmallerThan(FirstNumber=dprod, SecondNumber="-0.9")  # -> SmallerThan, OrEqualTo
panel = Panel("1.3")
dispatch = Dispatch(List=facen.Centers, DispatchPattern=smaller.SmallerThan)  # -> ListA, ListB
lng = ListLength(List=dispatch.ListA)
division = Division(A=lng, B=Slider(1.05, range=1..2))
reduce = RandomReduce(List=dispatch.ListA, Reduction=division, Seed=1)
pdecon = Deconstruct(Point=reduce)  # -> XComponent, YComponent, ZComponent
pt = ConstructPoint(XCoordinate=pdecon.XComponent, YCoordinate=pdecon.YComponent, ZCoordinate=Slider(0, range=-10..1))
ln = Line(StartPoint=reduce, EndPoint=pt)
len = Length(Curve=ln)
addition = Addition(A=len, B=Slider(0.01, range=0..0.01))
multiplication = Multiplication(A=addition, B=Slider(0.02, range=0..0.1))
mpipe = MeshPipe(Curve=ln, Radius=multiplication, Accuracy=0.2, Rotation=0, Segments=10, Caps=0)
M_2 = ClusterOutput(mpipe)
