# Grasshopper definition extrusions.gh (Grasshopper 0.9.76)
# plug-ins: Biomorpher

genes = GenePool(
    Decimals=2,
    Maximum=100,
    Minimum=0,
    Value=[31.61254326, 49.99269324, 6.332680912, 10.57677782, 58.17575737, 66.48462385, 71.41166868, 10.02866487, 85.32654, 46.60755487, 2.869396379, 24.57928617, 44.75701584, 8.611224549, 49.91466149, 4.544352416, 14.73786939, 85.40066773, 64.09159045, 44.43301779])
genes_2 = GenePool(
    Decimals=2,
    Maximum=100,
    Minimum=0,
    Value=[19.04428919, 95.4796277, 10.52621338, 56.53832176, 47.51246546, 72.84939921, 52.39026134, 39.57214083, 98.84190219, 61.70098528, 29.7501024, 92.72429193, 94.04090717, 87.20917464, 73.89987119, 92.28792959, 44.94262554, 96.59807673, 73.49940714, 36.60471441])
# In this example, genepools are used to
# create planar curves that are then extruded.
# Double click on the biomorpher component to begin.
genes_3 = GenePool(
    Decimals=2,
    Maximum=100,
    Minimum=0,
    Value=[42.28062282, 51.27530645, 7.174854543, 31.67516451, 3.089338263, 5.473242144, 15.90497783, 7.240092897, 63.40713257, 23.04186729, 10.09079391, 50.94539549, 34.34406399, 60.1066808, 14.61671713, 91.78302781, 82.81567152, 59.04927047, 95.83311383, 27.56871503])
pt = ConstructPoint(XCoordinate=genes_3, YCoordinate=genes, ZCoordinate=0)
qt = QuadTree(Points=pt, Plane=PlaneXY(0, 0, 0), Square=False, Group=Slider(1, range=0..10))  # -> Quads, Points
runion = RegionUnion(Curves=qt.Quads)
fillet = Fillet(Curve=runion, Radius=Slider(8.4, range=0..10))
lng = ListLength(List=fillet)
split = SplitList(List=genes_2, Index=lng)  # -> ListA, ListB
Z = UnitZ(Factor=split.ListA)
extr = Extrude(Base=fillet, Direction=Z)
cap = CapHoles(Brep=extr)
smooth = SettingsQuality()
mesh = MeshBrep(Brep=cap, Settings=smooth)
mcol = MeshColours(Mesh=mesh, Colours="Pink")
preview = CustomPreview(Geometry=mesh, Shader="Pink")
biomorpher = Biomorpher(Genome=[genes_3, genes, genes_2], Geometry=mcol)
