# Grasshopper definition genepools.gh (Grasshopper 0.9.76)
# plug-ins: Biomorpher

genes = GenePool(
    Decimals=2,
    Maximum=100,
    Minimum=0,
    Value=[52.26944957, 87.85379161, 74.05086778, 36.41310438, 91.91296128, 13.56483042, 33.17646051, 32.88501586, 29.57746271, 38.96852259])
genes_2 = GenePool(
    Decimals=2,
    Maximum=100,
    Minimum=0,
    Value=[60.87401005, 36.98543861, 48.18738622, 62.29500219, 63.10014798, 37.49914562, 68.4494723, 26.11258832, 23.07220899, 65.02142971])
pt = ConstructPoint(XCoordinate=genes_2, YCoordinate=genes, ZCoordinate=0)
msphereex = MeshSphereEx(Base=pt, Radius=10, Count=5)
biomorpher = Biomorpher(Sliders=[genes_2, genes], Geometry=msphereex)
