# Grasshopper definition mobius.gh (Grasshopper 0.9.76)
# plug-ins: Biomorpher, MeshEdit Components, LunchBox, Weaverbird

number_slider = Slider(2, range=0..5)
number_slider_2 = Slider(9, range=2..10)
number_slider_3 = Slider(45, range=29..100)
mobius = MobiusSurface(
    UDivisions=100,
    VDivisions=100,
    RParameter=4,
    TParameter=number_slider,
    Scale=5,
    Domain1=Domain(-3.141592654, 3.141592654),
    Domain2=Domain(-1, 1))
hex = HexagonCells(Surface=mobius, UDivisions=number_slider_3, VDivisions=number_slider_2, TParameter=0.25)  # -> HexagonCells, Centers
wbframe = WeaverbirdsPictureFrame(MeshPolylines=hex.HexagonCells, Distance=5, InsetType=0)
panel = Panel("255,0,0")
wbthicken = WeaverbirdsMeshThicken(MeshCurves=wbframe, Distance=Slider(2.9, range=0..10), OffsetType=0)
demesh = DeconstructMesh(Mesh=wbthicken)  # -> Vertices, Faces, Colours, Normals
pdecon = Deconstruct(Point=demesh.Vertices)  # -> XComponent, YComponent, ZComponent
panel_2 = Panel("""Green
Blue""")
larger = LargerThan(FirstNumber=pdecon.XComponent, SecondNumber="0")  # -> LargerThan, OrEqualTo
item = ListItem(List=panel_2, Index=larger.LargerThan, Wrap=True)
mcol = MeshColours(Mesh=wbthicken, Colours=item)
area = MeshArea(Mesh=mcol)  # -> Area, Centroid
demesh_2 = DeconstructMesh(Mesh=mcol)  # -> Vertices, Faces, Colours, Normals
pdecon_2 = Deconstruct(Point=area.Centroid)  # -> XComponent, YComponent, ZComponent
lng = ListLength(List=demesh_2.Vertices)
lng_2 = ListLength(List=demesh_2.Faces)
biomorpher = Biomorpher(
    Genome=[number_slider_2, number_slider_3, number_slider],
    Geometry=mcol,
    Performance=[pdecon_2.XComponent, pdecon_2.YComponent, pdecon_2.ZComponent, lng, lng_2, area.Area, Slider(20, range=0..100), Slider(34, range=0..100)])
item_2 = ListItem(List=biomorpher, Index=0, Wrap=True)  # -> Item, Item1, Item2
pt = ConstructPoint(XCoordinate=item_2.Item, YCoordinate=item_2.Item1, ZCoordinate=item_2.Item2)

# ---- group: Cluster no.
cluster = Slider(0, range=0..12)

# ----
panel_3 = Panel(biomorpher)
pshift = ShiftPaths(Data=pt, Offset=-1)
branch = TreeBranch(Tree=pshift, Path=cluster, MaintainPaths=True)
tstat = TreeStatistics(Tree=pshift)  # -> Paths, Length, Count
range = Range(Domain=Domain(0, 1), Steps=expr("X-1", tstat.Count))
gradient = Gradient(
    LowerLimit=0,
    UpperLimit=1,
    Parameter=range,
    stops=[0: RGB(243, 57, 0), 0.1: RGB(236, 27, 60), 0.2: RGB(210, 0, 118), 0.3: RGB(103, 0, 120), 0.4: RGB(39, 72, 161), 0.5: RGB(1, 192, 229), 0.6: RGB(18, 178, 90), 0.7: RGB(79, 186, 8), 0.8: RGB(220, 237, 32), 0.9: RGB(247, 159, 20), 1: RGB(243, 57, 0)])
col = Colour(graft(gradient))
dots = DotDisplay(Point=pshift, Colour=col, Size=Slider(0.02, range=0..0.1))
