# Grasshopper definition embryo(requiresFroebel).gh (Grasshopper 1.0.7)
# plug-ins: Fröbel, MeshEdit Components, Embryo, Human, Biomorpher

block1 = Block1(InTrans=0)  # -> OutBox, OutPlane1, OutPlane2
block2 = Block2(InTrans=1, InHeight=1)  # -> OutBox, OutPlane1, OutPlane2, OutPlane3, OutPoint1
block2_2 = Block2(InTrans=1, InHeight=1)  # -> OutBox, OutPlane1, OutPlane2, OutPlane3, OutPoint1
block2_3 = Block2(InTrans=1, InHeight=1)  # -> OutBox, OutPlane1, OutPlane2, OutPlane3, OutPoint1
link2 = Link2()
g_slider9 = Slider(3.902, range=3..4.5)
g_slider8 = Slider(3.402, range=3..4.5)
g_slider7 = Slider(4.16, range=3..4.5)
g_slider6 = Slider(3.165, range=3..4.5)
g_slider5 = Slider(3.034, range=3..4.5)
g_slider4 = Slider(3.948, range=3..4.5)
g_slider3 = Slider(3.261, range=3..4.5)
g_slider2 = Slider(3.112, range=3..4.5)
g_slider1 = Slider(4.46, range=3..4.5)
g_slider0 = Slider(3.128, range=3..4.5)
number_slider = Slider(20, range=0..100)
genes = GenePool(
    Decimals=2,
    Maximum=5,
    Minimum=3,
    Value=[3.3465664, 4.774150658, 4.758005005, 3.336383584, 4.559400762, 3.056409838, 4.500639315, 3.277248264, 3.988243342, 3.530317116])
genes_2 = GenePool(
    Decimals=0,
    Maximum=4,
    Minimum=0,
    Value=[3.3991655, 3.142351482, 3.97245729, 2.397943628, 3.509651802, 0.2932933589, 0.3896851318, 2.258096167, 3.346506048, 2.815966736, 3.257598335, 1.135145696, 2.580582132, 1.42773603, 3.927700736, 0.9728871402])
genes_3 = GenePool(
    Decimals=0,
    Maximum=20,
    Minimum=0,
    Value=[0.5325282647, 0.8830961682, 3.230380911, 3.826374739, 0.8439735513, 16.80894336, 2.260330581, 5.849511282, 0.6745627246, 18.71473806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])
number_slider_2 = Slider(4.1, range=0..100)
pt = ConstructPoint(XCoordinate=Slider(37.5, range=0..1000), YCoordinate=50, ZCoordinate=0)
embryo = EmbryoSettings(
    Preview=Toggle(False),
    SliderDomain=Domain(3, 4.5),
    OneToOne=Toggle(True),
    GridX=120,
    GridY=150,
    RemoveDead=Toggle(True),
    OnlyTerminals=False)
xz = XZPlane(Origin=Point(0, 0, 0))
xz_2 = XZPlane(Origin=pt)
parent_output = ParentOutput(O=[xz, xz_2])
parent_output_2 = ParentOutput(O=number_slider_2)
g_block2 = Block2(InPlane=xz_2, InLength=g_slider6, AddStoreys=g_slider3)  # -> OutBox, OutPlane1, OutPlane2, OutPlane3, OutPoint1
g_block1 = Block1(InPlane=xz, InLength=g_slider8)  # -> OutBox, OutPlane1, OutPlane2
g_block1_2 = Block1(InPlane=xz, InLength=g_slider2)  # -> OutBox, OutPlane1, OutPlane2
g_block2_2 = Block2(InPlane=g_block1.OutPlane1, InLength=1, AddStoreys=1)  # -> OutBox, OutPlane1, OutPlane2, OutPlane3, OutPoint1
g_block1_3 = Block1(InPlane=g_block1.OutPlane2, InLength=1)  # -> OutBox, OutPlane1, OutPlane2
g_block2_3 = Block2(InPlane=g_block1_2.OutPlane1, InLength=g_slider5, AddStoreys=number_slider_2)  # -> OutBox, OutPlane1, OutPlane2, OutPlane3, OutPoint1
g_block2_4 = Block2(InPlane=g_block1_2.OutPlane2, InLength=g_slider0, AddStoreys=g_slider1)  # -> OutBox, OutPlane1, OutPlane2, OutPlane3, OutPoint1
embryo_2 = Embryo(
    Reset=Toggle(True),
    Sliders=Slider(10, range=0..10),
    Components=Slider(16, range=0..100),
    MetricGenes=genes,
    TopologyGenes=genes_3,
    FunctionGenes=genes_2,
    Settings=embryo,
    RandomOveride=Slider(16, range=0..100))  # -> Iterations, Components
g_block1_4 = Block1(InPlane=g_block2_2.OutPlane2, InLength=1)  # -> OutBox, OutPlane1, OutPlane2
g_block2_5 = Block2(InPlane=g_block2_4.OutPlane1, InLength=1, AddStoreys=1)  # -> OutBox, OutPlane1, OutPlane2, OutPlane3, OutPoint1
g_block2_6 = Block2(InPlane=g_block2_3.OutPoint1, InLength=g_slider7, AddStoreys=g_slider4)  # -> OutBox, OutPlane1, OutPlane2, OutPlane3, OutPoint1
g_block1_5 = Block1(InPlane=g_block2_4.OutPlane2, InLength=g_slider9)  # -> OutBox, OutPlane1, OutPlane2
g_link2 = Link2(InPoint1=g_block1_5.OutPlane1, InPoint2=xz_2)
g_block2_7 = Block2(InPlane=g_block2_5.OutPlane1, InLength=1, AddStoreys=1)  # -> OutBox, OutPlane1, OutPlane2, OutPlane3, OutPoint1
g_block2_8 = Block2(InPlane=g_block2_6.OutPlane3, InLength=1, AddStoreys=1)  # -> OutBox, OutPlane1, OutPlane2, OutPlane3, OutPoint1
g_block2_9 = Block2(InPlane=g_block2_6.OutPlane2, InLength=1, AddStoreys=1)  # -> OutBox, OutPlane1, OutPlane2, OutPlane3, OutPoint1
g_block2_10 = Block2(InPlane=g_block2_9.OutPlane2, InLength=1, AddStoreys=1)  # -> OutBox, OutPlane1, OutPlane2, OutPlane3, OutPoint1
get_geometry = GetGeometry(G=[g_block1_2.OutBox, g_block2_4.OutBox, g_block1.OutBox, g_block1_5.OutBox, g_block2_3.OutBox, g_block2_6.OutBox, g_block2.OutBox, g_link2, g_block2_9.OutBox, g_block2_8.OutBox, g_block2_5.OutBox, g_block1_3.OutBox, g_block2_10.OutBox, g_block2_2.OutBox, g_block2_7.OutBox, g_block1_4.OutBox])
pi = Pi(Factor=Slider(0, range=0..1))
rotate = Rotate(Geometry=get_geometry, Angle=pi, Plane=PlaneXY(0, 0, 0))  # -> Geometry, Transform
geo = Geometry(rotate.Geometry)
smesh = SimpleMesh(Brep=geo)
number_slider_3 = Slider(0.1, range=0..0.1)
vec = VectorXYZ(XComponent=0.1, YComponent=-0.11, ZComponent=0)  # -> Vector, Length
volume = MeshVolume(Mesh=smesh)  # -> Volume, Centroid
panel = Panel("C:\Users\su918958\Documents\Materials\maple_plywood.jpg")
number_slider_4 = Slider(0.5, range=0..1)
number_slider_5 = Slider(0.4, range=0..1)
larger = LargerThan(FirstNumber=volume.Volume, SecondNumber=Slider(10000, range=0..10000))  # -> LargerThan, OrEqualTo
dispatch = Dispatch(List=smesh, DispatchPattern=larger.LargerThan)  # -> ListA, ListB
mesh = Mesh(dispatch.ListB)
move = Move(Geometry=mesh, Motion=vec.Vector)  # -> Geometry, Transform
medges = MeshEdges(Mesh=move.Geometry)  # -> NakedEdges, InteriorEdges, NonManifoldEdges
mcol = MeshColours(Mesh=dispatch.ListB, Colours=ColourSwatch(SwatchColor=RGB(255, 0, 0)))
bbox = BoundingBox(Content=mesh, Plane=PlaneXY(0, 0, 0), UnionBox=True)  # -> Box, Box_2
scale_nu = ScaleNU(Geometry=bbox.Box, Plane=PlaneXY(0, 0, 0), ScaleX=number_slider_4, ScaleY=number_slider_4, ScaleZ=1)  # -> Geometry, Transform
mcol_2 = MeshColours(Mesh=dispatch.ListA, Colours=ColourSwatch(SwatchColor=RGB(48, 33, 33)))
num = Number(Tree({0}: [0.08694963906, 0.2915720582, 0.9321724772, 0.7896349415, 0.02190216678, 0.7881899838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], {1}: [0.06566499316, 0.03736237392, 0.03353249144, 0.9257668745, 0.5274363735, 0.650446798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], {2}: [0.3262264674, 0.9140376052, 0.6598325081, 0.2016317673, 0.7516992999, 0.0189338266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], {3}: [0.6001552658, 0.6458249179, 0.2007622706, 0.7957069924, 0.1673611152, 0.2869665731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], {4}: [0.8175321221, 0.4188992388, 0.04766172406, 0.7221879245, 0.2008255325, 0.1569569987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], {5}: [0.0536001297, 0.369945672, 0.7037764619, 0.9125202046, 0.4854861873, 0.0518057016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], {6}: [0.7372050601, 0.9744024118, 0.133575311, 0.2091987665, 0.3155177386, 0.400668435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], {7}: [0.9840167705, 0.6516756176, 0.1448861147, 0.09820992411, 0.5467824985, 0.412733061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], {8}: [0.6416600447, 0.08091126293, 0.8309926297, 0.3772908786, 0.8861833289, 0.0938257026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], {9}: [0.5331826646, 0.8370627155, 0.3565502411, 0.197136005, 0.6197143344, 0.8512522177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], {10}: [0.5700555162, 0.8394454484, 0.6849148086, 0.2660294968, 0.4773108505, 0.7384866833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], {11}: [0.8398068942, 0.07946733715, 0.638833585, 0.3984086171, 0.6466288141, 0.7597090354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]))
edges = BrepEdges(Brep=geo)  # -> Naked, Interior, NonManifold
boxmap = BoxMapping(Mesh=move.Geometry, Box=scale_nu.Geometry)
biomorpher = Biomorpher(Genome=[genes, genes_3, genes_2], Geometry=flatten([mcol_2, mcol]))  # -> GenoGuids, Population, Historic, Clusters
panel_2 = Panel(num)
preview = CustomPreview(Geometry=dispatch.ListA, Shader=ColourSwatch(SwatchColor=RGBA(255, 255, 255, 222)))
panel_3 = Panel(biomorpher.GenoGuids)
mesh_2 = Mesh(dispatch.ListA)
previewmat = CustomPreviewMaterials(Geometry=boxmap, DiffuseColor=ColourSwatch(SwatchColor=RGB(0, 0, 0)), Transparency=Slider(0.3, range=0..1))
medges_2 = MeshEdges(Mesh=mesh_2)  # -> NakedEdges, InteriorEdges, NonManifoldEdges
bbox_2 = BoundingBox(Content=mesh_2, Plane=PlaneXY(0, 0, 0), UnionBox=True)  # -> Box, Box_2
boxmap_2 = BoxMapping(Mesh=mesh_2, Box=bbox_2.Box)
previewmat_2 = CustomPreviewMaterials(
    Geometry=boxmap_2,
    DiffuseColor=RGB(255, 255, 255),
    Transparency=Slider(0, range=0..1),
    DiffuseBitmap="C:\Users\su918958\Documents\Materials\concrete03.jpg")
