# Grasshopper definition BooleanBoxes.gh (Grasshopper 0.9.76)
# plug-ins: Biomorpher, MeshEdit Components

# In this example, genepools are used to create boxes which are then subtracted
# from the overall bounding box. Double click on the Biomorpher component.
genes = GenePool(
    Decimals=2,
    Maximum=10,
    Minimum=0,
    Value=[1.161280955, 6.356511565, 5.544579919, 9.652953989, 6.568220254, 0.2924482799, 6.678782554, 1.657712275, 3.613526481, 1.152930111])
genes_2 = GenePool(
    Decimals=2,
    Maximum=10,
    Minimum=0,
    Value=[1.698601061, 4.668033399, 4.241275633, 3.983800986, 6.121633798, 9.226869312, 4.509472603, 4.481792739, 1.008699454, 9.293383819])
genes_3 = GenePool(
    Decimals=2,
    Maximum=10,
    Minimum=0,
    Value=[7.347032333, 8.727324871, 3.399018694, 4.357769932, 9.868488651, 6.741547088, 2.921404337, 0.6439773184, 3.441451487, 5.883276694])
genes_4 = GenePool(
    Decimals=2,
    Maximum=10,
    Minimum=0,
    Value=[1.119211996, 3.830164696, 2.427808985, 3.584054312, 4.052875281, 0.3590149054, 9.777117825, 9.095014559, 1.429185213, 8.917895969])
genes_5 = GenePool(
    Decimals=2,
    Maximum=10,
    Minimum=0,
    Value=[1.604863513, 9.39735584, 6.049099567, 4.391365992, 2.715171347, 6.822861405, 9.60098784, 9.819566441, 2.343615697, 0.02197105555])
genes_6 = GenePool(
    Decimals=2,
    Maximum=10,
    Minimum=0,
    Value=[5.743883661, 4.592296744, 8.888348707, 6.248451741, 8.874464989, 2.438956084, 2.962492871, 1.191809987, 9.789465338, 9.831673166])
dom = ConstructDomain(DomainStart=genes_5, DomainEnd=genes_6)
dom_2 = ConstructDomain(DomainStart=genes_3, DomainEnd=genes_4)
dom_3 = ConstructDomain(DomainStart=genes, DomainEnd=genes_2)
box = DomainBox(Base=PlaneXY(0, 0, 0), X=dom_3, Y=dom_2, Z=dom)
bbox = BoundingBox(Content=box, Plane=PlaneXY(0, 0, 0), UnionBox=True)  # -> Box, Box_2
volume = Volume(Geometry=bbox.Box)  # -> Volume, Centroid
scale = Scale(Geometry=bbox.Box, Center=volume.Centroid, Factor="0.9")  # -> Geometry, Transform
number_slider = Slider(252, range=0..254)
number_slider_2 = Slider(141, range=0..254)
number_slider_3 = Slider(158, range=0..254)
sdiff = SolidDifference(BrepsA=scale.Geometry, BrepsB=box)
rgb = ColourRGB(Alpha=255, Red=number_slider, Green=number_slider_2, Blue=number_slider_3)
mesh = MeshBrep(
    Brep=sdiff,
    Settings={GridMaxCount=0, GridMinCount=16, JaggedSeams=False, MaxEdgeLength=0, MinEdgeLength=0.0001, MinTolerance=0, Refine=True, RefineAngle=0, RelativeTolerance=0.65, SimplePlanes=True, Tolerance=0})
mjoin = MeshJoin(Meshes=mesh)
mcol = MeshColours(Mesh=mjoin, Colours=rgb)
volume_2 = MeshVolume(Mesh=mcol)  # -> Volume, Centroid
biomorpher = Biomorpher(
    Genome=[number_slider, number_slider_2, number_slider_3, genes, genes_2, genes_3, genes_4, genes_5, genes_6],
    Geometry=mcol,
    Performance=volume_2.Volume)  # -> GenoGuids, Population, Historic, Clusters

# ---- group: Visualise Cluster Distribution
viewer = ParamViewer(biomorpher.Clusters)

# ---- group: Internalise these to store data
id = Guid()
num = Number()
num_2 = Number()

# ---- group: Biomorpher Reader component
biomorpherreader = BiomorpherReader(DesignID=Slider(38, range=0..99))
