# Grasshopper definition EmbryoExample.gh (Grasshopper 0.9.76)
# plug-ins: Biomorpher, embryoA

pt = ConstructPoint(XCoordinate=0, YCoordinate=0, ZCoordinate=0)
pt_2 = ConstructPoint(XCoordinate=0, YCoordinate=0, ZCoordinate=0)
pt_3 = ConstructPoint(XCoordinate=0, YCoordinate=0, ZCoordinate=0)
box_corners = BoxCorners()  # -> CornerA, CornerB, CornerC, CornerD, CornerE, CornerF, CornerG, CornerH
# Try disabling this plane by 3 points
pl_3pt = Plane3Pt()
pl_3pt_2 = Plane3Pt()
box = Box2Pt(Plane=PlaneXY(0, 0, 0))
box_2 = CenterBox(Base=PlaneXY(0, 0, 0), X=1, Y=1, Z=1)
rotate = Rotate(Angle=1.570796327, Plane=PlaneXY(0, 0, 0))  # -> Geometry, Transform; disabled
genes = GenePool(
    Decimals=2,
    Maximum=10,
    Minimum=-10,
    Value=[5.198471227, 8.436421016, 4.184414462, 8.391086403, -2.138109725, 1.632920649, -4.569872373, 7.455164156, -7.542353774, -2.145089308])
genes_2 = GenePool(
    Decimals=0,
    Maximum=100,
    Minimum=0,
    Value=[78.42162218, 70.68203044, 54.72609333, 44.87521581, 67.62693751, 48.92891168, 10.82528858, 33.72731355, 16.20194033, 96.37035457])
genes_3 = GenePool(
    Decimals=0,
    Maximum=100,
    Minimum=0,
    Value=[46.80801991, 17.26512146, 47.01316503, 62.32895053, 22.60203428, 82.05719957, 32.42314362, 94.36001726, 39.59586399, 0.9291933388])
g_slider19 = Slider(-2.15, range=-10..10)
g_slider18 = Slider(-7.54, range=-10..10)
g_slider17 = Slider(7.46, range=-10..10)
g_slider16 = Slider(-4.57, range=-10..10)
g_slider15 = Slider(1.63, range=-10..10)
g_slider14 = Slider(-2.14, range=-10..10)
g_slider13 = Slider(8.39, range=-10..10)
g_slider12 = Slider(4.18, range=-10..10)
g_slider11 = Slider(8.44, range=-10..10)
g_slider10 = Slider(5.2, range=-10..10)
g_slider9 = Slider(-2.15, range=-10..10)
g_slider8 = Slider(-7.54, range=-10..10)
g_slider7 = Slider(7.46, range=-10..10)
g_slider6 = Slider(-4.57, range=-10..10)
g_slider5 = Slider(1.63, range=-10..10)
g_slider4 = Slider(-2.14, range=-10..10)
g_slider3 = Slider(8.39, range=-10..10)
g_slider2 = Slider(4.18, range=-10..10)
g_slider1 = Slider(8.44, range=-10..10)
g_slider0 = Slider(5.2, range=-10..10)
# Embryo Settings
embryo = EmbryoSettings(
    Preview=Toggle(False),
    SliderDomain=Domain(-10, 10),
    OneToOne=Toggle(True),
    GridX=120,
    GridY=120,
    RemoveDead=True,
    OnlyTerminals=Toggle(True))
embryo_2 = Embryo(
    Reset=Toggle(True),
    Sliders=Slider(20, range=0..100),
    Components=Slider(31, range=0..1000),
    MetricGenes=genes,
    TopologyGenes=genes_2,
    FunctionGenes=genes_3,
    Settings=embryo,
    RandomOveride=0)  # -> Iterations, Components
g_pt = ConstructPoint(XCoordinate=0, YCoordinate=0, ZCoordinate=0)
g_pt_2 = ConstructPoint(XCoordinate=0, YCoordinate=0, ZCoordinate=0)
g_pt_3 = ConstructPoint(XCoordinate=g_slider8, YCoordinate=g_slider13, ZCoordinate=0)
g_pt_4 = ConstructPoint(XCoordinate=g_slider7, YCoordinate=g_slider10, ZCoordinate=g_slider16)
g_pt_5 = ConstructPoint(XCoordinate=g_slider11, YCoordinate=g_slider2, ZCoordinate=g_slider17)
g_pt_6 = ConstructPoint(XCoordinate=g_slider4, YCoordinate=g_slider5, ZCoordinate=g_slider6)
g_pt_7 = ConstructPoint(XCoordinate=g_slider19, YCoordinate=g_slider9, ZCoordinate=g_slider12)
g_pt_8 = ConstructPoint(XCoordinate=g_slider0, YCoordinate=g_slider3, ZCoordinate=g_slider15)
g_pt_9 = ConstructPoint(XCoordinate=g_slider18, YCoordinate=g_slider14, ZCoordinate=g_slider1)
g_box = Box2Pt(PointA=g_pt_7, PointB=g_pt_9, Plane=g_pt_8)
g_box_corners = BoxCorners(Box=g_box)  # -> CornerA, CornerB, CornerC, CornerD, CornerE, CornerF, CornerG, CornerH
g_box_2 = Box2Pt(PointA=g_box_corners.CornerC, PointB=g_box_corners.CornerE, Plane=g_box_corners.CornerG)
g_pl_3pt = Plane3Pt(PointA=g_box_corners.CornerD, PointB=g_box_corners.CornerH, PointC=g_box_corners.CornerF)
g_box_corners_2 = BoxCorners(Box=g_box_2)  # -> CornerA, CornerB, CornerC, CornerD, CornerE, CornerF, CornerG, CornerH
g_pl_3pt_2 = Plane3Pt(PointA=g_box_corners.CornerA, PointB=g_pl_3pt, PointC=g_pt_4)
g_pl_3pt_3 = Plane3Pt(PointA=g_box_corners_2.CornerC, PointB=g_box_corners_2.CornerA, PointC=g_box_corners_2.CornerE)
g_box_3 = Box2Pt(PointA=g_box_corners.CornerB, PointB=g_pt_5, Plane=g_pl_3pt_2)
g_box_corners_3 = BoxCorners(Box=g_box_3)  # -> CornerA, CornerB, CornerC, CornerD, CornerE, CornerF, CornerG, CornerH
g_box_4 = Box2Pt(PointA=g_box_corners_2.CornerD, PointB=g_box_corners_3.CornerC, Plane=g_box_corners_3.CornerB)
g_pl_3pt_4 = Plane3Pt(PointA=g_box_corners_3.CornerD, PointB=g_box_corners_3.CornerH, PointC=g_box_corners_3.CornerF)
get_geometry = GetGeometry(G=[g_box, g_box_2, g_box_3, g_box_4])
# Clean geometry
clean = CleanTree(RemoveNulls=True, RemoveInvalid=True, RemoveEmpty=False, Tree=get_geometry)
lng = ListLength(List=clean)
# Boolean anything solid
cluster = Cluster(geo=clean)
dom = ConstructDomain(DomainStart=Slider(-83, range=-100..0), DomainEnd=Slider(86.79, range=0..100))
dom_2 = ConstructDomain(DomainStart=Slider(-50.232, range=-100..0), DomainEnd=Slider(50.09, range=0..100))
box_3 = DomainBox(Base=PlaneXY(0, 0, 0), X=dom, Y=dom_2, Z=Domain(0, 140))
# Post Production
bbox = BoundingBox(Content=cluster, Plane=PlaneXY(0, 0, 0), UnionBox=True)  # -> Box, Box_2
# Map to a target shape
boxmap = BoxMapping(Geometry=cluster, Source=bbox.Box, Target=box_3)  # -> Geometry, Transform
# GEA and Floor to Floor
panel = Panel("144000")
number_slider = Slider(100, range=0..100)
fastbrepvolume = FastBrepVolume(InputBrep=boxmap.Geometry)
multiplication = Multiplication(A=panel, B="3.6")
# Scale in Z to hit target volume
division = Division(A=multiplication, B=fastbrepvolume)
# Mesh the thing
custom_mesh_settings = SettingsCustom(
    StitchSeams=True,
    SimplePlanes=False,
    Refine=True,
    MinCount=Slider(0, range=0..100),
    MaxCount=400,
    AspectRatio=20,
    MaxDistance=0,
    MaxAngle=20,
    MinEdge=number_slider,
    MaxEdge=number_slider)
scale_nu = ScaleNU(Geometry=boxmap.Geometry, Plane=PlaneXY(0, 0, 0), ScaleX=1, ScaleY=1, ScaleZ=division)  # -> Geometry, Transform
mesh = MeshBrep(Brep=scale_nu.Geometry, Settings=custom_mesh_settings)
wires = BrepWireframe(Brep=scale_nu.Geometry, Density=-1)
mjoin = MeshJoin(Meshes=mesh)
cluster_2 = Cluster_2(M=mjoin)
preview = CustomPreview(Geometry=wires, Shader=ColourSwatch(SwatchColor=RGB(0, 0, 0)))
clean_2 = CleanTree(RemoveNulls=True, RemoveInvalid=True, RemoveEmpty=False, Tree=cluster_2)
mjoin_2 = MeshJoin(Meshes=clean_2)
lng_2 = ListLength(List=clean_2)
mcol = MeshColours(Mesh=mjoin, Colours=ColourSwatch(SwatchColor=RGB(255, 255, 255)))
mcol_2 = MeshColours(Mesh=mjoin_2, Colours=ColourSwatch(SwatchColor=RGB(0, 0, 0)))
# Make some columns
biomorpher = Biomorpher(Genome=[genes, genes_2, genes_3], MeshEs=[mcol, mcol_2], Performance=[lng, lng_2])  # -> GenoGuids, Population, Historic, Clusters

# ==== cluster Cluster
geo = ClusterInput()
geo_2 = Geometry(geo)
fastbrepvolume = FastBrepVolume(InputBrep=geo_2)
larger = LargerThan(FirstNumber=fastbrepvolume, SecondNumber="10")  # -> LargerThan, OrEqualTo
dispatch = Dispatch(List=geo_2, DispatchPattern=larger.LargerThan)  # -> ListA, ListB
cap = CapHoles(Brep=dispatch.ListA)
sunion = SolidUnion(Breps=flatten(cap))
R = ClusterOutput(sunion)

# ==== cluster Cluster_2
M = ClusterInput()
Z = UnitZ(Factor=1)
facen = FaceNormals(Mesh=M)  # -> Centers, Normals
dprod = DotProduct(VectorA=facen.Normals, VectorB=Z, Unitize=True)
smaller = SmallerThan(FirstNumber=dprod, SecondNumber="-0.9")  # -> SmallerThan, OrEqualTo
dispatch = Dispatch(List=facen.Centers, DispatchPattern=smaller.SmallerThan)  # -> ListA, ListB
pdecon = Deconstruct(Point=dispatch.ListA)  # -> XComponent, YComponent, ZComponent
pt = ConstructPoint(XCoordinate=pdecon.XComponent, YCoordinate=pdecon.YComponent, ZCoordinate=0)
ln = Line(StartPoint=dispatch.ListA, EndPoint=pt)
len = Length(Curve=ln)
addition = Addition(A=len, B=Slider(0.01, range=0..0.01))
multiplication = Multiplication(A=addition, B=Slider(0.05, range=0..0.1))
mpipe = MeshPipe(Curve=ln, Radius=multiplication, Accuracy=0.2, Rotation=0, Segments=10, Caps=0)
M_2 = ClusterOutput(mpipe)
