# Grasshopper definition K2Example_HenryMoore.gh (Grasshopper 0.9.76)
# plug-ins: Biomorpher, MarchingCubes, MeshEdit Components, Weaverbird, Kangaroo2 Components

# ---- group: Boundary curve
# Sculptures are generated resembling the work of the artist Henry Moore.
# You will need Kangaroo 2, Weaverbird and Cocoon plug-ins.
# Double click on the Biomorpher component to begin.
crv = Curve(reparameterize(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))

# ----
number_slider = Slider(0.77, range=0..1)
genes = GenePool(Decimals=4, Maximum=1, Minimum=0, Value=[0.6339209776, 0.4999228941, 0.09223346569, 0.2883593303, 0.3515171026])
seam = Seam(Curve=crv, Seam=number_slider)
eval = EvaluateCurve(Curve=reparameterize(seam), Parameter=genes)  # -> Point, Tangent, Angle
cps = ClosestPoints(Point=eval.Point, Cloud=eval.Point, Count=Slider(3, range=0..10))  # -> ClosestPoint, CPIndex, Distance

# ---- group: Exclude self
split = SplitList(List=simplify(cps.ClosestPoint), Index=Slider(1, range=0..1))  # -> ListA, ListB

# ----
ln = Line(StartPoint=graft(eval.Point), EndPoint=split.ListB)  # -> flatten(Line)
len = Length(Curve=ln)
division = Division(A=len, B=Slider(8, range=0..100))
divide = DivideCurve(Curve=ln, Count=division, Kinks=False)  # -> Points, Tangents, Parameters
pline = PolyLine(Vertices=divide.Points, Closed=False)
explode = Explode(Curve=pline, Recursive=True)  # -> Segments, Vertices
Z = UnitZ(Factor=Slider(20, range=0..100))
end = EndPoints(Curve=ln)  # -> Start, End
load = Load(Point=explode.Vertices, ForceVector=Z)
length_line = LengthLine(Line=explode.Segments, Length=Slider(0, range=0..100), Strength=10)
anchor = Anchor(Point=[end.Start, end.End], Strength=10000)
show = Show(G=pline)
entwine = Entwine(Branch00=show, Branch01=length_line, Branch02=load, Branch03=anchor, FlattenInputs=True)
zombiesolver = ZombieSolver(GoalObjects=entwine, Threshold=1e-10, Tolerance=0.01, MaxIterations=50000)  # -> I, V, O
lng = ListLength(List=ln)

# ---- group: K2 Zombie Solver won't preserve tree structure
split_2 = SplitList(List=zombiesolver.O, Index=lng)  # -> ListA, ListB

# ----
curve_charge = CurveCharge(Curve=flatten(split_2.ListA), Radius=Slider(12, range=0..100), ChargeStrengths=Slider(7.76, range=0..10))
cocoon = Cocoon(
    Charges=flatten(curve_charge),
    Iso=Slider(4.01, range=0..10),
    CellSize=Slider(4, range=0..10),
    Execute=Toggle(True),
    Simple=False)  # -> Mesh, RefinementData
wblaplace = WeaverbirdsLaplacianSmoothing(MeshCurves=cocoon.Mesh, Level=Slider(10, range=0..10), SmoothNakedEdges=2, Thin=1)
mjoin = MeshJoin(Meshes=wblaplace)
volume = MeshVolume(Mesh=mjoin)  # -> Volume, Centroid
mcol = MeshColours(Mesh=mjoin, Colours=ColourSwatch(SwatchColor=RGB(129, 67, 141)))

# ---- group: (Avoid null)
addition = Addition(A=volume.Volume, B=Slider(0.01, range=0..0.01))

# ----
biomorpher = Biomorpher(Genome=[genes, number_slider], Geometry=mcol, Performance=addition)  # -> GenoGuids, Population, Historic, Clusters
