# Grasshopper definition KarambaExample.gh (Grasshopper 1.0.7)
# plug-ins: Karamba, Biomorpher

panel = Panel("""4
-4""")
# Evolves a 3d space frame by minimising deflection.
# Requires Karamba FE Analysis to run
panel_2 = Panel("""1
-1""")
genes = GenePool(Decimals=1, Maximum=8, Minimum=0, Value=[8, 4.5])
genes_2 = GenePool(Decimals=1, Maximum=8, Minimum=0, Value=[7.309852839, 7.68274776])
genes_3 = GenePool(Decimals=1, Maximum=8, Minimum=0, Value=[7.023220103, 2.78437183])
pt = ConstructPoint(XCoordinate=0, YCoordinate=0, ZCoordinate=0)
pt_2 = ConstructPoint(XCoordinate=0, YCoordinate=panel_2, ZCoordinate=Slider(4, range=0..10))
pt_3 = ConstructPoint(XCoordinate=Slider(12, range=0..100), YCoordinate=panel, ZCoordinate=0)
pt_4 = ConstructPoint(XCoordinate=genes_2, YCoordinate=genes, ZCoordinate=genes_3)
merge = Merge(Data1=pt, Data2=pt_2, Data3=pt_3, Data4=pt_4)
panel_3 = Panel("-100")
pt_5 = Point([pt, pt_2])
neg = Negative(Value=Slider(2578, range=0..10000))
xz = XZPlane(Origin=Point(0, 0, 0))
mirror = Mirror(Geometry=pt_4, Plane=xz)  # -> Geometry, Transform
ln = Line(StartPoint=pt_4, EndPoint=mirror.Geometry)
con = DelaunayEdges(Points=merge, Plane=xz)  # -> Connectivity, Edges
Z = UnitZ(Factor=neg)
mirror_2 = Mirror(Geometry=con.Edges, Plane=xz)  # -> Geometry, Transform
supp = SupportKaramba(PosInd=pt_5, menu=[buttons(on, on, on, on, off, on)])
loads = LoadsKaramba(ForceVector=Z, Local=False, PosInd=pt_3, LCase=0, mode="Point")
msphereex = MeshSphereEx(Base=pt_5, Radius=0.3, Count=2)
linetobeam = LineToBeamKaramba(Line=flatten([con.Edges, mirror_2.Geometry, ln]), New=True, Remove=True, LimitDistance_m=0.005)  # -> Element, Points, Info
mjoin = MeshJoin(Meshes=msphereex)
assemble = AssembleModelKaramba(Elem=linetobeam.Element, Support=supp, Load=loads, LimitDistance_m=0.005)  # -> Model, Info, Mass_kg, CenterOfGravity
analyzethi = AnalyzeThIKaramba(Model=assemble.Model)  # -> CalculatedModel, MaximumDisplacement_m, ResultingForceOfGravity_kN, ElasticEnergy_kNm
mcol = MeshColours(Mesh=mjoin, Colours=ColourSwatch(SwatchColor=RGB(0, 64, 255)))
modelview = ModelViewKaramba(Model=analyzethi.CalculatedModel, LoadCaseFactorsForLinearSuperposition=1, IndexOfVisibleLoadcase=-1)  # -> Model, DeformedMesh, DeformedAxes, DeformedModel
beamview = BeamViewKaramba(Model=modelview.Model)  # -> Model, MeshesOfRenderedBeams, DeformedBeamAxes, LegendColors, LegendTags
biomorpher = Biomorpher(Genome=[genes_2, genes_3], MeshEs=[mcol, beamview.MeshesOfRenderedBeams], Performance=analyzethi.MaximumDisplacement_m)
