# Grasshopper definition LunchboxExample.gh (Grasshopper 1.0.7)
# plug-ins: MeshEdit Components, Biomorpher, LunchBox, Weaverbird

# Möbius band that is discretised into hexgaonal cells.
# Requires Weaverbird and Lunchbox plug-ins.
number_slider = Slider(1, range=0..5)
number_slider_2 = Slider(6, range=2..10)
number_slider_3 = Slider(19, range=6..50)
mobius = MobiusSurface(
    UDivisions=100,
    VDivisions=100,
    RParameter=4,
    TParameter=number_slider,
    Scale=5,
    Domain1=Domain(-3.141592654, 3.141592654),
    Domain2=Domain(-1, 1))
hex = HexagonCells(Surface=mobius, UDivisions=number_slider_3, VDivisions=number_slider_2, TParameter=0.25)  # -> HexagonCells, Centers
number_slider_4 = Slider(0.9642, range=0..1)
number_slider_5 = Slider(0.9996, range=0..1)
number_slider_6 = Slider(0.9288, range=0..1)
number_slider_7 = Slider(9.9, range=0..10)
wbframe = WeaverbirdsPictureFrame(MeshPolylines=hex.HexagonCells, Distance=5, InsetType=0)
wbthicken = WeaverbirdsMeshThicken(MeshCurves=wbframe, Distance=number_slider_7, OffsetType=0)
frgb = ColourRGBF(Alpha=1, Red=number_slider_4, Green=number_slider_6, Blue=number_slider_5)
mcol = MeshColours(Mesh=wbthicken, Colours=frgb)
demesh = DeconstructMesh(Mesh=mcol)  # -> Vertices, Faces, Colours, Normals
lng = ListLength(List=demesh.Vertices)
area = MeshArea(Mesh=mcol)  # -> Area, Centroid
ma = MassAddition(Input=[number_slider_4, number_slider_6, number_slider_5])  # -> Lightness, PartialResults
biomorpher = Biomorpher(
    Genome=[number_slider_5, number_slider_6, number_slider_4, number_slider, number_slider_2, number_slider_3, number_slider_7],
    MeshEs=mcol,
    Performance=flatten([area.Area, lng, ma.Lightness]))  # -> GenoGuids, Population, Historic, Clusters

# ---- group: Try using an iniial population
num = Number(Tree({0}: [0.4729744911, 0.3088956318, 0.2994010208, 0.1540541608, 0.8977035791, 0.1529138783, 0.1248360281], {1}: [0.3436780601, 0.7891755061, 0.3621062075, 0.006236092656, 0.9116534036, 0.5184979357, 0.416556841], {2}: [0.207301031, 0.1762760566, 0.155733123, 0.629456403, 0.03194887519, 0.1249112711, 0.1931166864], {3}: [0.70505035, 0.5249011435, 0.6211788257, 0.7382715986, 0.6000307219, 0.6431155892, 0.9868990108], {4}: [0.2927757782, 0.8827862278, 0.008460145913, 0.4664106828, 0.7183785279, 0.8144395192, 0.2248932092], {5}: [0.1867518798, 0.7846368303, 0.4218627738, 0.03206568166, 0.8026366815, 0.5050472275, 0.122999745]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))

# ---- group: Visualise Cluster Distribution
viewer = ParamViewer(biomorpher.Clusters)

# ----
number_slider_8 = Slider(25, range=0..99)  # disabled

# ---- group: Biomorpher Reader component
biomorpherreader = BiomorpherReader(GenoGuids=biomorpher.GenoGuids, Population=biomorpher.Population, DesignID=number_slider_8)  # disabled
