# Grasshopper definition QuadtreeExtrusions.gh (Grasshopper 1.0.7)
# plug-ins: MeshEdit Components, Biomorpher

genes = GenePool(
    Decimals=2,
    Maximum=100,
    Minimum=0,
    Value=[23.48687491, 34.49105041, 71.20788316, 53.8718353, 95.37807299, 92.89290568, 56.00154483, 86.19146805, 41.09875029, 85.66146595, 8.773825189, 19.29852464, 58.79635545, 23.16886275, 68.70211527, 71.52874058, 67.5878582, 49.10136988, 86.57268935, 57.26042243])
genes_2 = GenePool(
    Decimals=2,
    Maximum=50,
    Minimum=0,
    Value=[20.05235089, 21.27915811, 18.38751458, 33.40703708, 20.58260155, 0.4374980184, 31.65474384, 27.65271553, 20.45684828, 7.891814508, 47.43349978, 16.43480978, 37.17918812, 13.93407707, 14.72270498, 1.554989581, 10.730673, 41.65875688, 4.348067565, 48.96873624])
# Modelling
genes_3 = GenePool(
    Decimals=2,
    Maximum=100,
    Minimum=0,
    Value=[37.65102957, 92.61922917, 37.13934906, 4.024208123, 90.78037815, 56.18987599, 29.75494518, 56.36793331, 50.79061458, 31.76222632, 96.74362048, 20.41268709, 10.4623781, 88.48347831, 34.35521946, 53.3923357, 14.86965268, 60.63561987, 59.22777108, 34.6341309])
pt = ConstructPoint(XCoordinate=genes_3, YCoordinate=genes, ZCoordinate=0)
qt = QuadTree(Points=pt, Plane=PlaneXY(0, 0, 0), Square=False, Group=Slider(1, range=0..10))  # -> Quads, Points
runion = RegionUnion(Curves=qt.Quads)
fillet = Fillet(Curve=runion, Radius=Slider(2, range=0..10))
lng = ListLength(List=fillet)
split = SplitList(List=genes_2, Index=lng)  # -> ListA, ListB
Z = UnitZ(Factor=split.ListA)
extr = Extrude(Base=fillet, Direction=Z)
cap = CapHoles(Brep=extr)
smooth = SettingsQuality()
mesh = MeshBrep(Brep=cap, Settings=smooth)
lng_2 = ListLength(List=mesh)
random = Random(Range=Domain(0, 1), Number=lng_2, Seed=2)
random_2 = Random(Range=Domain(0, 1), Number=lng_2, Seed=3)
random_3 = Random(Range=Domain(0, 1), Number=lng_2, Seed=4)
frgb = ColourRGBF(Alpha=1, Red=random, Green=random_2, Blue=random_3)
mcol = MeshColours(Mesh=graft(mesh), Colours=graft(frgb))
preview = CustomPreview(Geometry=cap, Shader=frgb)
# Analysis
demesh = DeconstructMesh(Mesh=mcol)  # -> flatten(Vertices), Faces, Colours, Normals
volume = Volume(Geometry=mcol)  # -> flatten(Volume), Centroid
area = MeshArea(Mesh=mcol)  # -> flatten(Area), Centroid
pdecon = Deconstruct(Point=demesh.Vertices)  # -> XComponent, YComponent, ZComponent
ma = MassAddition(Input=volume.Volume)  # -> Result, PartialResults
floor_to_floor_height = Slider(3, range=0..10)
ma_2 = MassAddition(Input=area.Area)  # -> Result, PartialResults
sort = SortList(Keys=pdecon.ZComponent)  # -> reverse(Keys), ValuesA
item = ListItem(List=sort.Keys, Index=0, Wrap=True)
division = Division(A=ma_2.Result, B=ma.Result)
division_2 = Division(A=ma.Result, B=floor_to_floor_height)
peakheight_m = Number(item)
biomorpher = Biomorpher(Genome=[genes_3, genes, genes_2], Meshes=mcol, Perform=[peakheight_m, division_2, division])
