# Grasshopper definition UntangleThread.gh (Grasshopper 0.9.76)
# plug-ins: Biomorpher

# Try to untangle a thread.
# This is a very tricky problem to set an objective function
# (i.e. using Galapagos), but easier if a human can judge
# success at each generation.
# Double click on the biomorpher component to begin.
# Needs meshpipe component.
genes = GenePool(
    Decimals=2,
    Maximum=100,
    Minimum=-100,
    Value=[-40.59270263, 38.73177998, -77.34687366, 66.66671554, 83.01271157, 94.35428308, 94.67858702, -44.82015153, -53.21413375, -9.906350995])
genes_2 = GenePool(
    Decimals=2,
    Maximum=100,
    Minimum=-100,
    Value=[-77.27832006, 69.28199951, -25.97295338, 52.7093943, 1.446405496, -21.29347655, -17.08901404, -77.18317293, 69.74574673, 32.26142674])
genes_3 = GenePool(
    Decimals=2,
    Maximum=100,
    Minimum=0,
    Value=[15.81133357, 62.00873767, 31.54179377, 55.27254588, 52.41050576, 38.9708759, 12.69795673, 38.98920575, 75.61181321, 45.61473869])
pt = ConstructPoint(XCoordinate=genes, YCoordinate=genes_2, ZCoordinate=genes_3)
intcrv = Interpolate(Vertices=pt, Degree=3, Periodic=True, KnotStyle=1)  # -> Curve, Length, Domain
divide = DivideCurve(Curve=intcrv.Curve, Count=Slider(100, range=0..100), Kinks=False)  # -> Points, Tangents, Parameters
curvature = Curvature(Curve=intcrv.Curve, Parameter=divide.Parameters)  # -> P, K, C
unit = UnitVector(Vector=curvature.K)
vdisex = VectorDisplayEx(Point=curvature.P, Vector=expr("x*100", curvature.K), Colour=RGB(0, 0, 0), Width=2)

# ---- group: Variance of curvature
vlen = VectorLength(Vector=curvature.K)
cluster = Cluster(num=vlen)

# ----
line = LineSDL(Start=curvature.P, Direction=unit, Length=Slider(6, range=0..10))
loft = Loft(Curves=line, Options={Adjust=False, Closed=True, LoftEnds=0, LoftSimp=0, LoftType=0, Rebuild=10, Refit=0.01})
preview = CustomPreview(
    Geometry=loft,
    Shader={ambient=RGB(0, 0, 0), diffuse=RGB(255, 105, 180), emission=RGB(76, 32, 54), shine=0.5, specular=RGB(255, 255, 255), transparency=0})
mesh_uv = MeshSurface(Surface=loft, UCount=200, VCount=5, Overhang=True, Equalize=False)
biomorpher = Biomorpher(Genome=[genes, genes_2, genes_3], Geometry=mesh_uv, Performance=[intcrv.Length, cluster])  # -> GenoGuids, Population, Historic, Clusters

# ==== cluster Cluster
num = ClusterInput()
num_2 = Number(num)
avr = Average(Input=num_2)
subtraction = Subtraction(A=avr, B=num_2)
lng = ListLength(List=num_2)
sqr = Square(Value=subtraction)
ma = MassAddition(Input=sqr)  # -> Result, PartialResults
division = Division(A=ma.Result, B=lng)
R = ClusterOutput(division)
