# Grasshopper definition untanglethread.gh (Grasshopper 0.9.76)
# plug-ins: Biomorpher, Mesh Pipe

# Try to untangle a thread.
# This is a very tricky problem to set an objective function
# (i.e. using Galapagos), but easier if a human can judge
# success at each generation.
# Double click on the biomorpher component to begin.
# Needs meshpipe component.
genes = GenePool(
    Decimals=2,
    Maximum=100,
    Minimum=0,
    Value=[29.9779568, 74.57795077, 56.6402905, 79.17724488, 80.76411378, 98.96467547, 91.82112906, 81.24157338, 35.50436936, 64.51404512])
genes_2 = GenePool(
    Decimals=2,
    Maximum=100,
    Minimum=0,
    Value=[42.60100212, 35.27846766, 51.28814622, 32.49795806, 33.70650477, 14.9950781, 7.919826502, 51.63753091, 64.70868525, 38.74753008])
genes_3 = GenePool(
    Decimals=2,
    Maximum=100,
    Minimum=0,
    Value=[96.85537433, 65.54788349, 80.55568807, 30.81513254, 45.63829803, 92.08259722, 57.16329383, 76.97900067, 43.3595217, 72.81171296])
pt = ConstructPoint(XCoordinate=genes, YCoordinate=genes_2, ZCoordinate=genes_3)
nurbs = NurbsCurve(Vertices=pt, Degree=3, Periodic=True)  # -> Curve, Length, Domain
len = Length(Curve=nurbs.Curve)
mpipe = MeshPipe(Curve=nurbs.Curve, Radius="1", Accuracy=0.2, Rotation=0, Segments=10, Caps=2)
biomorpher = Biomorpher(Genome=[genes, genes_2, genes_3], Geometry=mpipe, Performance=len)
